% Simulink data dictionary max6691_unittest.sldd

maxHLstruct_Loc = Simulink.Bus()
  t1H: uint32
  t1L: uint32
  t2H: uint32
  t2L: uint32
  t3H: uint32
  t3L: uint32
  t4H: uint32
  t4L: uint32

maxTempStruct_Loc = Simulink.Bus()
  t1: single
  t1_valid: uint8
  t2: single
  t2_valid: uint8
  t3: single
  t3_valid: uint8
  t4: single
  t4_valid: uint8